# Grasshopper definition PythonScripting_McNeelEuropeGhPython001.gh (Grasshopper 1.0.7)
# plug-ins: Bifocals

construct_point = ConstructPoint(XCoordinate=0, YCoordinate=0, ZCoordinate=0)
expression = Expression(Expression="Format(\"{0}, {1}\", x, y)")
ghpython_script = GhPythonScript()  # -> out, first_output
# ---------- ghpython_script: Python ----------
__author__ = "Sculpture"
__version__ = "2020.05.11"

import rhinoscriptsyntax as rs

first_output = ("Hello Michael!")

print(first_output)
# ---------- end ghpython_script ----------
arc = Arc(Plane=PlaneXY(0, 0, 0), Radius=1, Angle=Domain(0, 3.141592654))  # -> Arc, Length
ghpython_script_2 = GhPythonScript()  # -> out, a; unedited script template
integer = Integer(Slider(3, range=0..10))
number = Number(Slider(3.7, range=0..10))
text = Text("ten or other number")
point = Point(construct_point)
boolean = Boolean(Toggle(False))
curve = Curve(arc.Arc)
boolean_2 = Boolean(Slider(0, range=0..1))
ghpython_script_3 = GhPythonScript()  # -> out, name
# ---------- ghpython_script_3: Python ----------
__author__ = "Sculpture"
__version__ = "2020.05.11"

import rhinoscriptsyntax as rs

boolean = True #True or False
integer = 10
decimal = 10.0
text = "this is a text"

#this is called assignment

#print integer
#print type(integer)
#print type(text)

#convert

bool_to_int = int(boolean)
print type(bool_to_int)
print bool_to_int

new_string = "100"
print new_string
print type(new_string)

str_to_int = int(new_string)
print type(str_to_int)

name = str_to_int
# ---------- end ghpython_script_3 ----------
ghpython_script_4 = GhPythonScript(x=Slider(8, range=0..10), y=Slider(3, range=0..10))  # -> out, a, b, c; inputs x: Int32, y: Int32
# ---------- ghpython_script_4: Python ----------
print x + y


operation = x + y * x - y
another = (x + y) * (x - y)

a = operation
b = another

c = round(x / y)
# ---------- end ghpython_script_4 ----------
ghpython_script_5 = GhPythonScript(boolean=boolean, integer=integer, decimal=number, text=text, point=point, curve=curve)  # -> out, output; inputs boolean: Boolean, integer: Int32, point: Point3d, curve: Curve
# ---------- ghpython_script_5: Python ----------
__author__ = "Sculpture"
__version__ = "2020.05.11"

import rhinoscriptsyntax as rs

#print boolean
#print integer
#print decimal
#print text

print point
print type(point)

print curve
print type(curve)

output = integer
# ---------- end ghpython_script_5 ----------
ghpython_script_6 = GhPythonScript(x=Slider(8, range=0..10), y=Slider(6, range=0..10))  # -> out, a; inputs x: Int32, y: Int32
# ---------- ghpython_script_6: Python ----------
__author__ = "Sculpture"
__version__ = "2020.05.11"

import rhinoscriptsyntax as rs

import math
import random


#print math.pi

#print math.pow(2,8)

#print 2**8

#degrees = math.degrees(math.pi)
#print degrees

#radians = math.radians(degrees)
#print radians

random_int = random.randint(10,20)
print random_int
# ---------- end ghpython_script_6 ----------
panel = Panel(ghpython_script_3.name)
panel_2 = Panel(boolean_2)
panel_3 = Panel(ghpython_script_4.out)
panel_4 = Panel(ghpython_script_4.a)
panel_5 = Panel(ghpython_script_4.b)
panel_6 = Panel(ghpython_script_4.c)
panel_7 = Panel(ghpython_script_6.out)
panel_8 = Panel(ghpython_script_5.out)
panel_9 = Panel(ghpython_script_5.output)
