# Grasshopper definition PythonScripting_McNeelEuropeGhPython002.gh (Grasshopper 1.0.7)
# plug-ins: Bifocals

char_sequence = CharSequence(Count=10, CharPool="ABCDEFGHIJKLMNOPQRSTUVWXYZ", Format="{0}")
sequence = Sequence(Notation="[N-1] + [N-2]", Length=20, Initial=[1, 1])
series = Series(Start=0, Step=1, Count=10)
text = Text(["Michael", "David", "Wickerson", "is", "the", "Greatest"])
panel = Panel("""carrot
apple
grape""")
panel_2 = Panel(text)
panel_3 = Panel(char_sequence)
panel_4 = Panel(series)
panel_5 = Panel("""Michael
David
Jim
Daniel
Boob""")
ghpython_script = GhPythonScript()  # -> out, a; unedited script template
panel_6 = Panel(sequence)
panel_7 = Panel("""Michael
David
Jim
Daniel
Boob""")
char_sequence_2 = CharSequence(Count=Slider(10, range=0..10), CharPool="ABCDEFGHIJKLMNOPQRSTUVWXYZ", Format="{0}")
series_2 = Series(Start=0, Step=1, Count=Slider(10, range=0..10))
panel_8 = Panel("""Michael
David
Jim
Daniel
Boob""")
series_3 = Series(Start=0, Step=1, Count=Slider(10, range=0..10))
ghpython_script_2 = GhPythonScript(names=panel_5, x=Slider(0, range=0..10), y=Slider(5, range=0..10))  # -> out, a; inputs names: list, x: Int32, y: Int32
# ---------- ghpython_script_2: Python ----------
__author__ = "Sculpture"
__version__ = "2020.05.12"

import rhinoscriptsyntax as rs

##slicing
#
##slice
#print names[:1]
#print names[:2]
#print names[:-1]
#print names[3:]

a = names[x:y]

#names_copy = names
##print names
##print names_copy
#
#names.append("luis")
#print names
#print names_copy
#
## not a copy  but a reference to it
#
#print names == names_copy
#print id(names)
#print id(names_copy)


#copy a list
names_copy = names[:]
print names
print names_copy

names.append("luis")
print names
print names_copy

#pretty tricky to understand copying and referencing

print names == names_copy
print id(names)
print id(names_copy)

#nesting lists
# ---------- end ghpython_script_2 ----------
panel_9 = Panel(series_2)
panel_10 = Panel(char_sequence_2)
text_2 = Text(["Michael", "David", "Wickerson", "is", "the", "Greatest"])
panel_11 = Panel(ghpython_script_2.out)
panel_12 = Panel(ghpython_script_2.a)
panel_13 = Panel(text_2)
ghpython_script_3 = GhPythonScript(names=panel_8, nums=series_3)  # -> out, a; inputs names: list, nums: list of Int32
# ---------- ghpython_script_3: Python ----------
__author__ = "Sculpture"
__version__ = "2020.05.12"

import rhinoscriptsyntax as rs

#other useful functions

#access list functions
#
##list.
#
#print len(names)
#print len(nums)

##sum of all items in numeric lists
#print sum(nums)
#
##get min/max value
#min = min(nums)
#max = max(nums)
#print min
#print max
#
#a = names
#
#names.pop(3)
#print names
#
##remove and item
#names.remove("Michael")
#
#names.reverse()

#sort a list
names.sort()
nums.sort()
print names
print nums
# ---------- end ghpython_script_3 ----------
ghpython_script_4 = GhPythonScript(start=Slider(0, range=0..10), stop=Slider(10, range=0..10), step=Slider(2, range=0..10))  # -> out, a; inputs start: Int32, stop: Int32, step: Int32
# ---------- ghpython_script_4: Python ----------
__author__ = "Sculpture"
__version__ = "2020.05.12"

import rhinoscriptsyntax as rs

#contro / comments everything and deselects everything!!!!
# or """ and """ start and end
##creating lists within the GhPython component
#
#empty_list = []
#
##does not work
##empty_list[0] = 40
#
##add items to a list
#empty_list.append("Wicked Wickerson")
#print empty_list
#empty_list.append("Toco Queen")
#print empty_list
#
##inserting items
#empty_list.insert(2, "Firehound")

#initialixe a list with items

#odd_nums = [1,3,5,7]
#print odd_nums
#odd_nums.append(9)
#print odd_nums

#range function (similar to the series component in gh)
#sequence is a range which is a list
#sequence = range(10)
#print sequence

#overwriting in in order
#
##sequence from 2 to 6
#odd_nums = range(3,18,2)
##print odd_nums
#
#series = range(start, stop, step)
#
#a = series

#slicing and copying lists
# ---------- end ghpython_script_4 ----------
ghpython_script_5 = GhPythonScript(names=panel_7, nums=series_2, chars=char_sequence_2)  # -> out, a; inputs names: list, nums: list of Int32, chars: list
# ---------- ghpython_script_5: Python ----------
__author__ = "Sculpture"
__version__ = "2020.05.12"

import rhinoscriptsyntax as rs

import ghpythonlib.treehelpers as th

#th.

#nested lists

print names
print nums
print chars

list_of_lists = [names,nums, chars]
print list_of_lists[0]
print list_of_lists[0][3]

a = th.list_to_tree(list_of_lists)
# ---------- end ghpython_script_5 ----------
panel_14 = Panel(ghpython_script_5.a)
panel_15 = Panel(ghpython_script_3.a)
ghpython_script_6 = GhPythonScript(fruit_list=panel_13, item=Slider(3, range=0..6))  # -> out, a; inputs fruit_list: list, item: Int32
# ---------- ghpython_script_6: Python ----------
__author__ = "Sculpture"
__version__ = "2020.05.12"

import rhinoscriptsyntax as rs

#bring lists into ghpython

#must go into "x" input fruit_list and click list access in ghpython node

#print fruit_list
#print type(fruit_list)

#access items in a list
last_fruit = fruit_list[-1]
#print first_fruit
#print last_fruit

#print first_fruit[-1]

#replace an item
#fruit_list[2] = "Dangerman"
#fruit_list[item] = 100

#A VERY POWERFUL TOOL FOR MANIPULATING GEOMETRIES!!!
#a = fruit_list

#creating lists within the GhPython component
# ---------- end ghpython_script_6 ----------
panel_16 = Panel(ghpython_script_5.out)
panel_17 = Panel(ghpython_script_3.out)
panel_18 = Panel(ghpython_script_4.a)
panel_19 = Panel(ghpython_script_6.a)
panel_20 = Panel(ghpython_script_6.out)
