# Grasshopper definition PythonScripting_McNeelEuropeGhPython003.gh (Grasshopper 1.0.7)
# plug-ins: Bifocals

panel = Panel("""this
is
a
list
of
strings""")
series = Series(Start=Slider(7, range=0..10), Step=1, Count=Slider(6, range=0..10))
ghpython_script = GhPythonScript(list_str=panel, list_num=series)  # -> out, a; inputs list_str: list, list_num: list of Int32
# ---------- ghpython_script: Python ----------
#conditionals

#iterations
#print list_str[0]
#print list_str[1]
#print list_str[2]
#print list_str[3]
#print list_str[4]
#print list_str[5]
#
#for i in list_str:
#    #do something
#    print i
#    print "done!"
##inside this scope
#
#a = i
#
#for x in ["this", "is", "another", "example"]:
#    print x

#for loops with indexes
#length_num_list = len(list_num)
#print length_num_list
#
#indexes = range(length_num_list)
#print list_num
#print indexes
#
#for i in indexes:
#    print i
#    print list_num[i]


#for i in range (len(list_num)):
#    print list_num[i]
#    
#    
#
##very cool!
#
#a = i
#print a

#for i in range (len(list_str)):
#    print list_str[i]
#    
#    

#very cool!

#a = i
#print a

total_addition = 0
even_addition = 0

for i in range (len(list_num)):
    #print list_num[i]
    total_addition = total_addition + list_num[i]
    
    if i % 2 == 0:
        even_addition = even_addition + list_num[i]
    
#print sum(list_num
print total_addition
print even_addition

#very cool!
# ---------- end ghpython_script ----------
panel_2 = Panel(ghpython_script.a)
panel_3 = Panel(ghpython_script.out)
