# Grasshopper definition PythonScripting_WickersonStudios001.gh (Grasshopper 1.0.7)
# plug-ins: Bifocals

ghpython_script = GhPythonScript(x=Slider(3, range=0..10), y=Slider(7, range=0..10), z=Slider(1.05, range=0..4))  # -> out, a, b, c, d; inputs x: Int32, y: Int32
# ---------- ghpython_script: Python ----------
import rhinoscriptsyntax as rs
import math

print x
points = range(x,x*y**2,10)
print points

a = points
print a


b = a*x
print b


c = math.cos(z)
#c = math.sin(z)
#c = math.tan(z)

lenB = len(b)
print lenB

#d = lenB *c
d = lenB *c
# ---------- end ghpython_script ----------
construct_point = ConstructPoint(XCoordinate=ghpython_script.a, YCoordinate=ghpython_script.b, ZCoordinate=ghpython_script.d)
construct_domain = ConstructDomain(DomainStart=ghpython_script.c, DomainEnd=Slider(2.77, range=0..10))
list_length = ListLength(List=ghpython_script.a)
panel = Panel(ghpython_script.out)
param_viewer = ParamViewer(ghpython_script.b)
interpolate = Interpolate(Vertices=construct_point, Degree=3, Periodic=False, KnotStyle=1)  # -> Curve, Length, Domain
range = Range(Domain=construct_domain, Steps=list_length)
pi = Pi(Factor=range)
panel_2 = Panel(ghpython_script.a)
rotate_3d = Rotate3D(Geometry=interpolate.Curve, Angle=pi, Center=Point(0, 0, 0), Axis=Vector(0, 0, 1))  # -> Geometry, Transform
panel_3 = Panel(ghpython_script.b)
multiplication = Multiplication(A=ghpython_script.a, B=ghpython_script.c)
panel_4 = Panel(ghpython_script.c)
pipe = Pipe(Curve=rotate_3d.Geometry, Radius=multiplication, Caps=2)
solid_union = SolidUnion(Breps=pipe)
